# Grasshopper definition Assigment 1. - GRIGORIADIS GEORGIOS.gh (Grasshopper 1.0.7)
# plug-ins: Kangaroo2 Components, DendroGH, ShapeDiverForGrasshopper, Human

sddp = ShapeDiverDocumentPayload({AbsoluteTolerance=0, AngleTolerance=0, DistanceDisplayPrecision=0, GltfVersion="Gltf2", GrasshopperVersion="1.0.0007", InputGroups="{}", OutputGroups="{}", RelativeTolerance=0, RhinoVersion="7.36.23346.16351", UnitSystem=0, VersionCreated="1.16.0.0", VersionSaved="1.16.0.0"})

# ---- group: Beams
number_of_points_group = Slider(5, range=0..50)
radius = Slider(1.414, range=0..2)
number_of_points_group_2 = GetNumber(
    number_of_points_group,
    AtLeast=1,
    AtMost=1,
    Maximum=1.797693135e+308,
    Minimum=-1.797693135e+308,
    Prompt="From 0 to 50",
    TreeAccess=False)
pipes_radius = GetNumber(
    radius,
    AtLeast=1,
    AtMost=1,
    Maximum=1.797693135e+308,
    Minimum=-1.797693135e+308,
    Prompt="From 1.0 to 2.0",
    TreeAccess=False)

# ---- group: Populate
number_of_points = Slider(106, range=0..1000)
seed = Slider(35, range=0..100)
number_of_points_2 = GetNumber(
    number_of_points,
    AtLeast=1,
    AtMost=1,
    Maximum=1.797693135e+308,
    Minimum=-1.797693135e+308,
    Prompt="Form 0 to 1000",
    TreeAccess=False)
seed_2 = GetNumber(seed, AtLeast=1, AtMost=1, Maximum=1.797693135e+308, Minimum=-1.797693135e+308, Prompt="Form 0 to 100", TreeAccess=False)

# ---- group: BOX
X = Slider(70, range=0..100)
Y = Slider(100, range=0..100)
Z = Slider(100, range=0..100)
x_of_box = GetNumber(X, AtLeast=1, AtMost=1, Maximum=1.797693135e+308, Minimum=-1.797693135e+308, Prompt="From 0 to 100", TreeAccess=False)
y_of_box = GetNumber(Y, AtLeast=1, AtMost=1, Maximum=1.797693135e+308, Minimum=-1.797693135e+308, Prompt="Form 0 to 100", TreeAccess=False)
z_of_box = GetNumber(Z, AtLeast=1, AtMost=1, Maximum=1.797693135e+308, Minimum=-1.797693135e+308, Prompt="Form 0 to 100", TreeAccess=False)

# ---- group: Sphere
sphere_radius = Slider(50, range=0..100)
sphere_radius_2 = GetNumber(
    sphere_radius,
    AtLeast=1,
    AtMost=1,
    Maximum=1.797693135e+308,
    Minimum=-1.797693135e+308,
    Prompt="From 0 to 100.",
    TreeAccess=False)

# ----
domain_box = DomainBox(Base=PlaneXY(0, 0, 0), X=x_of_box, Y=y_of_box, Z=z_of_box)

deconstruct_brep = DeconstructBrep(Brep=domain_box)  # -> Faces, Edges, Vertices
area = Area(Geometry=deconstruct_brep.Faces)  # -> Area, Centroid
deconstruct = Deconstruct(Point=area.Centroid)  # -> XComponent, YComponent, ZComponent
sort_list = SortList(Keys=deconstruct.ZComponent, ValuesValuesA=deconstruct_brep.Faces)  # -> Keys, ValuesValuesA
list_item = ListItem(List=sort_list.ValuesValuesA, Index="0", Wrap=True)
evaluate_surface = EvaluateSurface(Surface=reparameterize(list_item), Point="0.5,0.5")  # -> Point, Normal, UDirection, VDirection, Frame
sphere = Sphere(Base=evaluate_surface.Point, Radius=sphere_radius_2)

populate_3d = Populate3D(Region=domain_box, Count=number_of_points_2, Seed=seed_2)
point_in_brep = PointInBrep(Brep=sphere, Point=populate_3d, Strict=False)
gate_not = GateNot(A=point_in_brep)
cull_pattern = CullPattern(List=populate_3d, CullPattern=gate_not)

brep_wireframe = BrepWireframe(Brep=domain_box, Density=-1)
custom_preview = CustomPreview(Geometry=sphere, Material=ColourSwatch(SwatchColor=RGBA(252, 192, 192, 60)))
custom_preview_lineweights = CustomPreviewLineweights(Geometry=brep_wireframe, Shader=ColourSwatch(SwatchColor=RGB(0, 0, 0)), Absolute=False)

proximity_3d = Proximity3D(Points=cull_pattern, Group=number_of_points_group_2)  # -> flatten(Links), Topology
division = Division(A=pipes_radius, B="3")
create_settings = CreateSettings(VoxelSize=division, Bandwidth=1, Isovalue=0, Adaptivity=0.1)
removeduplicatelines = RemoveDuplicateLines(Lines=proximity_3d.Links, Tolerance=0.01)
curve_to_volume = CurveToVolume(Curves=removeduplicatelines, CurveRadius=pipes_radius, Settings=create_settings)
volume_to_mesh = VolumeToMesh(Volume=curve_to_volume, VolumeSettings=create_settings)
custom_preview_2 = CustomPreview(Geometry=volume_to_mesh, Material=ColourSwatch(SwatchColor=RGB(140, 148, 255)))
context_bake = ContextBake(Geometry=volume_to_mesh)
context_bake_2 = ContextBake(Geometry=removeduplicatelines)
